# Grasshopper definition python serial basic working.gh (Grasshopper 0.9.76)
# plug-ins: Python Interpreter

round = Round(Acceleration=Slider(8, range=1..255))  # -> Acceleration, Floor, Ceiling
round_2 = Round(Angle_us=Slider(759, range=544..2336))  # -> Angle_us, Floor, Ceiling
round_3 = Round(Angle_us=Slider(577, range=544..2336))  # -> Angle_us, Floor, Ceiling
round_4 = Round(Number=Slider(0, range=0..250))  # -> Nearest, Floor, Ceiling
open_port = PythonScript(baudrate=Slider(9600, range=0..112500), port="COM4", open=Toggle(True))  # -> out, a
# ---------- open_port: Python ----------
import serial
import scriptcontext

SCS = scriptcontext.sticky
K = 'serialport'

if K in SCS:
    myPort=SCS[K]
else:
    myPort=serial.Serial()
    
if open == True:
    try:
        myPort.baudrate = baudrate
        myPort.port = port
        myPort.open()
        SCS[K] = myPort
    except:
        print "Something went wrong. Cannot open port."
    if myPort.isOpen() == True:
        print myPort.name + " is open"
        
if open != True:
    try:
        myPort.close()
    except:
        print "Something went wrong. Cannot close port."
    if myPort.isOpen != True:
        print "Port is closed"
# ---------- end open_port ----------
servo_control = PythonScript(speed_val=round_4.Nearest, angle_us1=round_2.Angle_us, angle_us2=round_3.Angle_us)  # -> out, a
# ---------- servo_control: Python ----------
import serial
import scriptcontext
myPort = scriptcontext.sticky['serialport']

out_bytes = [0xAA, 0x00, 0x07, 0x00, None, None, 0xAA, 0x00, 0x07, 0x01, None, None, 0xAA, 0x00, 0x1F, 0x02, 0x00, None, None, None, None]

speed = speed_val * 4
out_bytes[4] = speed & 0x7F #Second byte holds the lower 7 bits of speed.
out_bytes[5] = (speed >> 7) & 0x7F # Third data byte holds the bits 7-13 of speed.
out_bytes[10] = speed & 0x7F #Second byte holds the lower 7 bits of speed.
out_bytes[11] = (speed >> 7) & 0x7F # Third data byte holds the bits 7-13 of speed.

target1 = angle_us1 * 4
target2 = angle_us2 * 4
out_bytes[17] = target1 & 0x7F #Second byte holds the lower 7 bits of target.
out_bytes[18] = (target1 >> 7) & 0x7F # Third data byte holds the bits 7-13 of target.
out_bytes[19] = target2 & 0x7F #Second byte holds the lower 7 bits of target.
out_bytes[20] = (target2 >> 7) & 0x7F # Third data byte holds the bits 7-13 of target.

print out_bytes
myPort.write(bytes(bytearray(out_bytes)))
# ---------- end servo_control ----------
panel = Panel(open_port.out)
